vi "Main.gvi"   [LabVIEW NXG 5.0.0]
panel controls:
  "Throttle": f64
  "Power switch": bool
  "Voltage control": f64
  "History": f64 = 2
  "Offset": f64
  "Delta": f64 = 5
panel indicators:
  "Vibration": waveform<f64>
  "Voltage": waveform<f64>
  "Vibration spectrum": T1
  "Voltage spectrum": T1
  "Frequency gauge": f64
  "Frequency indicator": f64
  "Voltage gauge": f64
  "Voltage indicator": f64
  "Current gauge": f64
  "Current indicator": f64
  "Power gauge": f64
  "Power indicator": f64
  "Order spectrum": T1
types:
  T1 = cluster{"f0": f64, "df": f64, "magnitude": f64[]}
uses:
  PSU::PSU_Initialization.gvi
  PSU::PSU_Loop.gvi
  NI::DAQmx::Internal::DAQmx Read (Analog 1D Wfm NChan NSamp Duration).gvi
  NI::Analysis::Measurement::Power Spectrum for 1 Chan.gvi
  NI::DAQmx::Internal::DAQmx Write (Counter Time 1Chan 1Samp).gvi
diagram:
  call "PSU_Initialization.gvi"(Session in="TCPIP0::192.168.0.35::inst0::INSTR") -> (Session out=w1)
  while {
    call "PSU_Loop.gvi"(Session in=w1, Power Button=$"Power switch", Voltage setting=$"Voltage control", Current setting=3.2) -> (Voltage output=w2, Current output=w3, Power output=w4)
    $"Voltage indicator" <- w2
    $"Voltage gauge" <- w2
    $"Current indicator" <- w3
    $"Current gauge" <- w3
    $"Power indicator" <- w4
    Wait Until Next Multiple(multiple to wait=100)
    $"Power gauge" <- w4
    stop if FALSE
  }
  w5 = "Input"  # Task in
  w6 = "Output"  # Task in
  while {
    w7 = 0.1  # Duration
    call "DAQmx Read (Analog 1D Wfm NChan NSamp Duration).gvi"(task in=w5, duration=w7) -> (data=w8)
    Array Index(array=w8) -> (out0[0]=w9)
    call "Waveform_History.gvi"(Waveform in=w9, History=$History) -> (Waveform out=w10)
    call "Power Spectrum for 1 Chan.gvi"(signal=w10) -> (power spectrum=w11)
    $"Vibration spectrum" <- w11
    Array Index(array=w8) -> (out0[1]=w12)
    call "Waveform_History.gvi"(Waveform in=w12, History=$History) -> (Waveform out=w13)
    call "Power Spectrum for 1 Chan.gvi"(signal=w13) -> (power spectrum=w14)
    call "Rotational_Speed.gvi"(Cluster in=w14) -> (Frequency=w15)
    call "Order_Tracking.gvi"(Vibration spectrum=w11, Frequency=w15) -> (Order Spectrum=w16)
    $"Order spectrum" <- w16
    call "X_Axis_Update.gvi"(Graph in=reference to "Order spectrum", Offset=$Offset, Delta=$Delta)
    call "Waveform_Conditioning.gvi"(Waveform in=w9, Time factor=1000, Signal factor=50, DC component=FALSE) -> (Output waveform=w17)
    $Vibration <- w17
    $"Frequency indicator" <- w15
    $"Frequency gauge" <- w15
    $"Voltage spectrum" <- w14
    call "Waveform_Conditioning.gvi"(Waveform in=w12, Time factor=1000, DC component=TRUE) -> (Output waveform=w18)
    $Voltage <- w18
    call "Y_Axis_Update.gvi"(Graph in=reference to "Voltage", Waveform=w18)
    call "Throttle.gvi"(Throttle=$Throttle) -> (Signal=w19)
    call "DAQmx Write (Counter Time 1Chan 1Samp).gvi"(task in=w6, high time=w19, low time=0.001, auto start=TRUE)
    stop if FALSE
  }
