vi "Order_Tracking.gvi"   [LabVIEW NXG 5.0.0]
inputs:
  "Vibration spectrum": T1
  "Frequency": f64
outputs:
  "Order Spectrum": T1
types:
  T1 = cluster{"f0": f64, "df": f64, "magnitude": f64[]}
diagram:
  Property Node(instance in=$"Vibration spectrum") -> ("df"=w1, "magnitude"=w2, instance out=w3)
  Divide(x=w1, y=$Frequency) -> w4
  Is Equal To 0(x=$Frequency) -> w5
  Select(s=w5, t=0, f=1) -> w6
  Multiply(w2, w6) -> w7
  Property Node(instance in=w3, "df"=w4, "magnitude"=w7) -> (instance out=w8)
  $"Order Spectrum" <- w8
