vi "PSU_Initialization.gvi"   [LabVIEW NXG 5.0.0]
inputs:
  "Session in": "VISA Instr"
  "Initialization": string = "*RST\n:OUTP:TRAC CH1,ON\n:OUTP:TRAC CH2,ON\n:APPL CH1,0,3.2\n:APPL CH2,0,3.2"
outputs:
  "Session out": "VISA Instr"
uses:
  NI::VISA::Open (Instr).gvi
  NI::VISA::Write (Instr, String).gvi
diagram:
  call "Open (Instr).gvi"(resource name=$"Session in") -> (session out=w1)
  call "Write (Instr, String).gvi"(session in=w1, write buffer=$Initialization) -> (session out=w2)
  $"Session out" <- w2
