vi "PSU_Loop.gvi"   [LabVIEW NXG 5.0.0]
inputs:
  "Session in": "VISA Instr"
  "Power Button": bool
  "Voltage setting": f64
  "Current setting": f64
outputs:
  "Session out": "VISA Instr"
  "Voltage output": f64
  "Current output": f64
  "Power output": f64
uses:
  PSU::PSU_Output.gvi
  PSU::PSU_Setting.gvi
  PSU::PSU_Measure.gvi
diagram:
  call "PSU_Output.gvi"(Session in=$"Session in", Power Button=$"Power Button", Channel=1) -> (Session out=w1)
  call "PSU_Output.gvi"(Session in=w1, Power Button=$"Power Button", Channel=2) -> (Session out=w2)
  call "PSU_Setting.gvi"(Session in=w2, Voltage=$"Voltage setting", Current=$"Current setting") -> (Session out=w3)
  call "PSU_Measure.gvi"(Session in=w3, Channel=1) -> (Session out=w4, Voltage=w5, Current=w6, Power=w7)
  call "PSU_Measure.gvi"(Session in=w4, Channel=2) -> (Session out=w8, Voltage=w9, Current=w10, Power=w11)
  $"Session out" <- w8
  Add(w9, w5) -> w12
  Divide(x=w12, y=2) -> w13
  $"Voltage output" <- w13
  Add(w10, w6) -> w14
  $"Current output" <- w14
  Add(w11, w7) -> w15
  $"Power output" <- w15
