vi "PSU_Measure.gvi"   [LabVIEW NXG 5.0.0]
inputs:
  "Session in": "VISA Instr"
  "Channel": u32 = 1
outputs:
  "Voltage": f64
  "Current": f64
  "Power": f64
  "Session out": "VISA Instr"
uses:
  NI::VISA::Write (Instr, String).gvi
  NI::VISA::Read (Instr, String).gvi
diagram:
  Format Into String(formatString=":MEAS:ALL? CH%d", $Channel) -> w1
  call "Write (Instr, String).gvi"(session in=$"Session in", write buffer=w1) -> (session out=w2)
  call "Read (Instr, String).gvi"(session in=w2, byte count=128) -> (session out=w3, read buffer=w4)
  $"Session out" <- w3
  Match Pattern(regular expression="[^,]+", string=w4) -> (after substring=w5, match substring=w6)
  Floating Point String To Number(string=w6) -> (number=w7)
  $Voltage <- w7
  Match Pattern(offset (0)=1, regular expression="[^,]+", string=w5) -> (after substring=w8, match substring=w9)
  Floating Point String To Number(string=w9) -> (number=w10)
  $Current <- w10
  Match Pattern(offset (0)=1, regular expression="[^,]+", string=w8) -> (match substring=w11)
  Floating Point String To Number(string=w11) -> (number=w12)
  $Power <- w12
