vi "PSU_Output.gvi"   [LabVIEW NXG 5.0.0]
inputs:
  "Session in": "VISA Instr"
  "Power Button": bool
  "Channel": u32 = 1
outputs:
  "Session out": "VISA Instr"
uses:
  NI::VISA::Write (Instr, String).gvi
diagram:
  Feedback Node(initial value=FALSE, input=$"Power Button") -> w1
  Is Not Equal(x=$"Power Button", y=w1) -> w2
  case (w2) {
    frame False, Default {
      w3 = $"Session in"
    }
    frame True {
      Select(s=$"Power Button", t=":OUTP CH%d,ON", f=":OUTP CH%d,OFF") -> w4
      Format Into String(formatString=w4, $Channel) -> w5
      call "Write (Instr, String).gvi"(session in=$"Session in", write buffer=w5) -> (session out=w3)
    }
  }
  $"Session out" <- w3
