vi "PSU_Setting.gvi"   [LabVIEW NXG 5.0.0]
inputs:
  "Session in": "VISA Instr"
  "Voltage": f64
  "Current": f64
  "Channel": u32 = 1
outputs:
  "Session out": "VISA Instr"
uses:
  NI::VISA::Write (Instr, String).gvi
diagram:
  Feedback Node(initial value=0, input=$Voltage) -> w1
  Is Not Equal(x=$Voltage, y=w1) -> w2
  case (w2) {
    frame False, Default {
      w3 = $"Session in"
    }
    frame True {
      Multiply($Voltage, 20) -> w4
      Round To Nearest(number=w4) -> w5
      Multiply(w5, 0.05) -> w6
      Format Into String(formatString=":APPL CH%d,%.3f,%.3f", $Channel, w6, $Current) -> w7
      call "Write (Instr, String).gvi"(session in=$"Session in", write buffer=w7) -> (session out=w3)
    }
  }
  $"Session out" <- w3
