vi "Rotational_Speed.gvi"   [LabVIEW NXG 5.0.0]
inputs:
  "Cluster in": T1
  "Min frequency": f64 = 50
  "Ratio": f64 = 7
  "Max frequency": f64 = 5000
  "Threshold": f64 = 0.01
outputs:
  "Frequency": f64
types:
  T1 = cluster{"f0": f64, "df": f64, "magnitude": f64[]}
diagram:
  Property Node(instance in=$"Cluster in") -> ("df"=w1, "magnitude"=w2)
  Divide(x=$"Min frequency", y=w1) -> w3
  To Signed 32 Bit Integer(number=w3) -> w4
  Divide(x=$"Max frequency", y=w1) -> w5
  Subtract(x=w5, y=w3) -> w6
  To Signed 32 Bit Integer(number=w6) -> w7
  Array Subset(array=w2, index0=w4, length0=w7) -> w8
  Array Max And Min(array=w8) -> (max index(es)=w9, max value=w10)
  Is Greater(x=$Threshold, y=w10) -> w11
  Add(w9, w4) -> w12
  To Double Precision Float(number=w12) -> w13
  Multiply(w1, w13) -> w14
  Divide(x=w14, y=$Ratio) -> w15
  Select(s=w11, t=0, f=w15) -> w16
  $Frequency <- w16
