vi "Throttle.gvi"   [LabVIEW NXG 5.0.0]
inputs:
  "Throttle": f64
  "Min": f64 = 0.001
  "Max": f64 = 0.002
  "Off": f64 = 0.00095
outputs:
  "Signal": f64
diagram:
  Subtract(x=$Max, y=$Min) -> w1
  Multiply(w1, $Throttle) -> w2
  Add($Min, w2) -> w3
  Is Equal(x=$Min, y=w3) -> w4
  Select(s=w4, t=$Off, f=w3) -> w5
  $Signal <- w5
