vi "Waveform_Conditioning.gvi"   [LabVIEW NXG 5.0.0]
inputs:
  "Waveform in": waveform<f64> = {dt=1, Y=[]}
  "Signal factor": f64 = 1
  "Time factor": f64 = 1
  "DC component": bool
outputs:
  "Output waveform": waveform<f64>
uses:
  NI::Analysis::Statistics::Mean (DBL).gvi
diagram:
  Property Node(instance in=$"Waveform in") -> ("Y"=w1, "dt"=w2, "t0"=w3, "attributes"=w4)
  Multiply($"Time factor", w2) -> w5
  Multiply($"Signal factor", w1) -> w6
  call "Mean (DBL).gvi"(x=w6) -> (mean=w7)
  Select(s=$"DC component", t=0, f=w7) -> w8
  Subtract(x=w6, y=w8) -> w9
  Build Waveform Node(Y=w9, attributes=w4, dt=w5, t0=w3) -> (output waveform=w10)
  $"Output waveform" <- w10
