vi "Waveform_History.gvi"   [LabVIEW NXG 5.0.0]
inputs:
  "Waveform in": waveform<f64> = {dt=1, Y=[]}
  "History": f64
outputs:
  "Waveform out": waveform<f64>
diagram:
  Property Node(instance in=$"Waveform in") -> ("Y"=w1, "dt"=w2, "t0"=w3, "attributes"=w4)
  Feedback Node(input=w5) -> w6
  Array Size(array=w6) -> (size(s)=w7)
  Insert Into Array(inArray=w6, index0=w7, new=w1) -> w8
  Divide(x=$History, y=w2) -> w9
  To Signed 32 Bit Integer(number=w9) -> w10
  Array Size(array=w8) -> (size(s)=w11)
  Subtract(x=w11, y=w10) -> w12
  Array Subset(array=w8, index0=w12, length0=w10) -> w5
  Build Waveform Node(Y=w5, attributes=w4, dt=w2, t0=w3) -> (output waveform=w13)
  $"Waveform out" <- w13
