vi "X_Axis_Update.gvi"   [LabVIEW NXG 5.0.0]
inputs:
  "Graph in": "Graph reference"
  "Delta": f64 = 5
  "Offset": f64
diagram:
  Add($Offset, $Delta) -> w1
  Property Node(instance in=cluster{"Minimum": f64, "Maximum": f64} {all zero or empty}, "Minimum"=$Offset, "Maximum"=w1) -> (instance out=w2)
  Property Node(instance in=$"Graph in") -> ("XScale"=w3)
  Property Node(instance in=w3, "Range"=w2)
