vi "Y_Axis_Update.gvi"   [LabVIEW NXG 5.0.0]
inputs:
  "Waveform": waveform<f64> = {dt=1, Y=[]}
  "Graph in": "Graph reference"
uses:
  NI::G Core::Waveform::Analog Waveform::Waveform Min Max.gvi
diagram:
  call "Waveform Min Max.gvi"(waveform=$Waveform) -> (Y max=w1)
  Round Toward Positive Infinity(x=w1) -> w2
  Property Node(instance in=cluster{"Minimum": f64, "Maximum": f64} {all zero or empty}, "Minimum"=-1, "Maximum"=w2) -> (instance out=w3)
  Property Node(instance in=$"Graph in") -> ("YScale"=w4)
  Property Node(instance in=w4, "Range"=w3)
